# Grasshopper definition Cantilever.gh (Grasshopper 1.0.8)
# Copyright: hrntsm
# plug-ins: Lemur Info, IguanaMesh

number_slider = Slider(10, range=0..10)
number_slider_2 = Slider(100, range=0..100)
pt = ConstructPoint(XCoordinate=number_slider_2, YCoordinate=number_slider, ZCoordinate=number_slider)
pt_2 = Point(Point(0, 0, 0))
division = Division(A=number_slider, B="2")
box = Box2Pt(PointA=pt_2, PointB=pt, Plane=PlaneXY(0, 0, 0))
number_slider_3 = Slider(10, range=0..100)
addition = Addition(A=Slider(10, range=0..10), B=number_slider)
pt_3 = ConstructPoint(XCoordinate=expr("x-10", number_slider_2), YCoordinate=division, ZCoordinate=expr("x+1", addition))
neg = Negative(Value=number_slider_3)

# ----
# Mesh Size
number_slider_4 = Slider(3.5, range=0..5)

dom = ConstructDomain(DomainStart=neg, DomainEnd=number_slider_3)
xy = XYPlane(Origin=pt_3)
box_2 = DomainBox(Base=xy, X=dom, Y=dom, Z=dom)
debrep = DeconstructBrep(Brep=box_2)  # -> Faces, Edges, Vertices
ilineartetraprism = ILinearTetraPrism(
    MinimumSize=number_slider_4,
    MaximunSize=number_slider_4,
    CurvatureAdapt=True,
    MinimumElements=6,
    Optimization=1,
    QualityType=2,
    QualityThreshold=0.3,
    Massive_Refinement=True)
item = ListItem(List=debrep.Faces, Index=Slider(4, range=0..5), Wrap=True)
debrep_2 = DeconstructBrep(Brep=box)  # -> Faces, Edges, Vertices
ifillbrep = IFillBrep(Brep=[box, box_2], ISettings=ilineartetraprism)  # -> IMesh, Entities, Info
item_2 = ListItem(List=ifillbrep.IMesh, Index=0, Wrap=True)  # -> Item, Item1
item_3 = ListItem(List=debrep_2.Faces, Index=Slider(3, range=0..5), Wrap=True)
item_4 = ListItem(List=debrep_2.Faces, Index=Slider(5, range=0..5), Wrap=True)
Z = UnitZ(Factor=Slider(10, range=0..10))
vec = VectorXYZ(XComponent=0, YComponent=0, ZComponent=0)  # -> Vector, Length
neg_2 = Negative(Value=Z)
lefi = LeMeshFromIMesh(Header="Cantilever", IMesh=item_2.Item)  # -> LeMesh, Mesh
lefi_2 = LeMeshFromIMesh(Header="Box", IMesh=item_2.Item1)  # -> LeMesh, Mesh
conbc = ConstructBoundaryCondition(TargetGroupName="DISP", Type=Slider(0, range=0..10), Values=neg_2, Constraints=[True, True, True])
conbc_2 = ConstructBoundaryCondition(TargetGroupName="Fix", Type=0, Values=vec.Vector, Constraints=[True, True, True])
conss = ConstructSolverSettings(Method=Slider(12, range=0..12), Precondition=Slider(1, range=0..12), MaxIter=100, Residual=1e-08)
constep = ConstructStep(SubSteps=Slider(10, range=0..10), Convergence=1e-06, MaxIterations=100)
concon = ConstructContact(Name="CP1", Slave="Slave", Master="Master", Algorithm=0, Interaction=1)  # -> ContactPair, ContactControl
conlemat = ConstructLeMaterial(Name="steel", Density="1", YoungsModulus="205000", PoissonRatio="0.3", TargetEGroup="EGRP1")
mergelemesh = MergeLeMesh(LeMesh1=lefi.LeMesh, LeMesh2=lefi_2.LeMesh)  # -> LeMesh, Mesh
congrpsurf = GroupFromSurface(Name="Fix", LeMesh=mergelemesh.LeMesh, Surface=item_3, GroupType=Slider(0, range=0..2), Tolerance=1e-06)  # -> Group, Geometry, NodeIds
congrpsurf_2 = GroupFromSurface(Name="DISP", LeMesh=mergelemesh.LeMesh, Surface=item, GroupType=Slider(0, range=0..2), Tolerance=1e-06)  # -> Group, Geometry, NodeIds
congrpsurf_3 = GroupFromSurface(Name="Master", LeMesh=mergelemesh.LeMesh, Surface=item_4, GroupType=Slider(2, range=0..2), Tolerance=1e-06)  # -> Group, Geometry, NodeIds
congrpsurf_4 = GroupFromSurface(Name="Slave", LeMesh=mergelemesh.LeMesh, Surface=item, GroupType=Slider(2, range=0..2), Tolerance=1e-06)  # -> Group, Geometry, NodeIds
grpentire = GroupEntireLeMesh(Name="EGRP1", LeMesh=mergelemesh.LeMesh)
conlecnt = ConstructLeControl(
    SolutionType=Slider(1, range=0..1),
    BoundaryConditions=flatten([conbc_2, conbc]),
    ContactControl=concon.ContactControl,
    Step=constep,
    Solver=conss)
panel = Panel(mergelemesh.LeMesh)
panel_2 = Panel(conlecnt)
conleasm = LeAssembleModel(
    LeMesh=mergelemesh.LeMesh,
    LeGrp=flatten([congrpsurf.Group, grpentire, congrpsurf_3.Group, congrpsurf_2.Group, congrpsurf_4.Group]),
    LeCntMsh=concon.ContactPair,
    LeMat=conlemat,
    LeCnt=conlecnt)
path = FilePath("C:\Users\hiroa\Desktop\lemur_test\")
panel_3 = Panel(conleasm)
leexe = LeExecute(LeAssemble=conleasm, Thread="-1", Process="1", Dir=path, Run=Toggle(True))  # -> LeMesh, Dir
panel_4 = Panel("REACTION_FORCE")  # disabled
panel_5 = Panel(leexe.LeMesh)
number_slider_5 = Slider(10, range=1..10)  # disabled
number_slider_6 = Slider(2, range=0..10)  # disabled
number_slider_7 = Slider(1, range=0..10)  # disabled
panel_6 = Panel("NodalMISES")  # disabled
getnodalresult = NodalResult(LeMesh=leexe.LeMesh, TargetResultName=panel_4, Step=number_slider_5, NodeIDs=congrpsurf.NodeIds)  # disabled
lecontour = ShowResultContour(LeMesh=leexe.LeMesh, Step=number_slider_5, ResultName=panel_6, ContourSet=number_slider_6, DispScale=number_slider_7)  # -> Mesh, Color, Text; disabled
num2pt = NumbersToPoints(Numbers=getnodalresult, Mask=4)  # disabled
ma = MassAddition(Input=flatten(num2pt))  # -> Result, PartialResults; disabled
legend = Legend(Colour=lecontour.Color, Tags=lecontour.Text, LegendType=1)  # disabled
panel_7 = Panel(ma.Result)  # disabled
