# Grasshopper definition Cantilever_Tied.gh (Grasshopper 1.0.8)
# Copyright: hrntsm
# plug-ins: Heteroptera, Lemur Info, IguanaMesh

number_slider = Slider(10, range=0..10)
number_slider_2 = Slider(3, range=0..100)

# ----
# Mesh Size
number_slider_3 = Slider(3.5, range=0..5)

number_slider_4 = Slider(14, range=0..100)
pt = ConstructPoint(XCoordinate=Slider(100, range=0..100), YCoordinate=number_slider, ZCoordinate=number_slider)
pt_2 = Point(Point(0, 0, 0))
X = UnitX(Factor=number_slider_2)
division = Division(A=number_slider_2, B=2)
box = Box2Pt(PointA=pt_2, PointB=pt, Plane=PlaneXY(0, 0, 0))
debrep = DeconstructBrep(Brep=box)  # -> Faces, Edges, Vertices
item = ListItem(List=debrep.Faces, Index=Slider(1, range=0..10), Wrap=True)
area = Area(Geometry=item)  # -> Area, Centroid
domsym = DomainSymmetric(Length=number_slider_4, Base=0)
X_2 = UnitX(Factor=division)
yz = YZPlane(Origin=area.Centroid)
neg = Negative(Value=X_2)
rectangle = Rectangle(Plane=yz, XSize=domsym, YSize=domsym, Radius=0)  # -> Rectangle, Length
boundary = BoundarySurfaces(Edges=rectangle.Rectangle)
extr = Extrude(Base=boundary, Direction=X)
move = Move(Geometry=extr, Motion=neg)  # -> Geometry, Transform
X_3 = UnitX(Factor=number_slider_4)
number_slider_5 = Slider(1, range=0..1.1)
extr_2 = Extrude(Base=boundary, Direction=X_3)
multiplication = Multiplication(A=number_slider_3, B=Slider(3, range=1..5))
ilineartetraprism = ILinearTetraPrism(
    MinimumSize=number_slider_5,
    MaximunSize=number_slider_3,
    CurvatureAdapt=True,
    MinimumElements=6,
    Optimization=1,
    QualityType=2,
    QualityThreshold=0.3,
    Massive_Refinement=True)
iboxfield = IBoxField(Box=move.Geometry, Thickness=multiplication, SizeInside=number_slider_5, SizeOutside=number_slider_3)
debrep_2 = DeconstructBrep(Brep=extr_2)  # -> Faces, Edges, Vertices
debrep_3 = DeconstructBrep(Brep=box)  # -> Faces, Edges, Vertices
item_2 = ListItem(List=debrep_2.Faces, Index=Slider(5, range=0..10), Wrap=True)
ifillbrep = IFillBrep(Brep=flatten([box, extr_2]), IMeshField=iboxfield, ISettings=ilineartetraprism)  # -> IMesh, Entities, Info
item_3 = ListItem(List=debrep_2.Faces, Index=Slider(4, range=0..10), Wrap=True)
item_4 = ListItem(List=ifillbrep.IMesh, Index=0, Wrap=True)  # -> Item, Item1
item_5 = ListItem(List=debrep_3.Faces, Index=Slider(3, range=0..5), Wrap=True)
item_6 = ListItem(List=debrep_3.Faces, Index=Slider(1, range=0..5), Wrap=True)
X_4 = UnitX(Factor=Slider(10, range=0..10))
vec = VectorXYZ(XComponent=0, YComponent=0, ZComponent=0)  # -> Vector, Length
lefi = LeMeshFromIMesh(Header="Cantilever", IMesh=item_4.Item)  # -> LeMesh, Mesh, Edges
lefi_2 = LeMeshFromIMesh(Header="Box", IMesh=item_4.Item1)  # -> LeMesh, Mesh, Edges
conbc = ConstructBoundaryCondition(TargetGroupName="DISP", Type=Slider(0, range=0..10), Values=X_4, Constraints=[True, True, True])
conbc_2 = ConstructBoundaryCondition(TargetGroupName="Fix", Type=0, Values=vec.Vector, Constraints=[True, True, True])
conss = ConstructSolverSettings(Method=Slider(12, range=0..12), Precondition=Slider(5, range=0..12), MaxIter=100, Residual=1e-08)
constep = ConstructStep(SubSteps=Slider(5, range=0..10), Convergence=1e-06, MaxIterations=100)
concon = ConstructContact(Name="CP1", Slave="Slave", Master="Master", Algorithm=Slider(1, range=0..1), Interaction=Slider(2, range=0..10))  # -> ContactPair, ContactControl
conlemat = ConstructLeMaterial(Name="steel", Density="1", YoungsModulus="205000", PoissonRatio="0.3")
mergelemesh = MergeLeMesh(LeMesh1=lefi.LeMesh, LeMesh2=lefi_2.LeMesh)  # -> LeMesh, Mesh, Edges
congrpsurf = GroupFromSurface(Name="Fix", LeMesh=mergelemesh.LeMesh, Surface=item_5, GroupType=Slider(0, range=0..2), Tolerance=1e-06)  # -> Group, Geometry, NodeIds
congrpsurf_2 = GroupFromSurface(Name="DISP", LeMesh=mergelemesh.LeMesh, Surface=item_2, GroupType=Slider(0, range=0..2), Tolerance=1e-06)  # -> Group, Geometry, NodeIds
congrpsurf_3 = GroupFromSurface(Name="Master", LeMesh=mergelemesh.LeMesh, Surface=item_6, GroupType=Slider(2, range=0..2), Tolerance=1e-06)  # -> Group, Geometry, NodeIds
congrpsurf_4 = GroupFromSurface(Name="Slave", LeMesh=mergelemesh.LeMesh, Surface=item_3, GroupType=Slider(2, range=0..2), Tolerance=1e-06)  # -> Group, Geometry, NodeIds
grpentire = GroupEntireLeMesh(Name="EGRP1", LeMesh=mergelemesh.LeMesh)
conlesection_solid = ConstructLeSectionSolid(EGroups="EGRP1", LeMaterial=conlemat)
conlecnt = ConstructLeControl(
    SolutionType=Slider(1, range=0..1),
    BoundaryConditions=flatten([conbc_2, conbc]),
    ContactControl=concon.ContactControl,
    Step=constep,
    Solver=conss)
panel = Panel(mergelemesh.LeMesh)
panel_2 = Panel(conlecnt)
conleasm = LeAssembleModel(
    LeMesh=mergelemesh.LeMesh,
    LeGroup=flatten([congrpsurf.Group, grpentire, congrpsurf_3.Group, congrpsurf_2.Group, congrpsurf_4.Group]),
    ContactMsh=concon.ContactPair,
    LeSection=conlesection_solid,
    LeControl=conlecnt)
path = FilePath("C:\Users\hiroa\Desktop\lemur_test\")
panel_3 = Panel(conleasm)
leexe = LeExecute(LeAssemble=conleasm, Thread="-1", Process="1", Dir=path, Run=Toggle(True))  # -> LeMesh, Dir
panel_4 = Panel(leexe.LeMesh)
number_slider_6 = Slider(5, range=1..10)
filter = StreamFilter(Gate=Slider(0, range=0..1), Stream0="DISPLACEMENT", Stream1="NodalMISES")
getnodalresult = NodalResult(LeMesh=leexe.LeMesh, TargetResultName="REACTION_FORCE", Step=number_slider_6, NodeIDs=congrpsurf.NodeIds)
lecontour = ShowResultContour(
    LeMesh=leexe.LeMesh,
    Step=number_slider_6,
    ResultName=filter,
    ContourSet=Slider(2, range=0..10),
    DispScale=Slider(1, range=0..10))  # -> Mesh, Color, Text
num2pt = NumbersToPoints(Numbers=getnodalresult, Mask=4)
ma = MassAddition(Input=flatten(num2pt))  # -> Result, PartialResults
legend = Legend(Colour=lecontour.Color, Tags=lecontour.Text, LegendType=1)
panel_5 = Panel(ma.Result)
