# Grasshopper definition Cantilever_TipLoad.gh (Grasshopper 1.0.8)
# Copyright: hrntsm
# plug-ins: Pufferfish, Lemur Info, IguanaMesh

yz = YZPlane(Origin=Point(0, 0, 0))
cyl = Cylinder(Base=yz, Radius=Slider(5, range=0..10), Length=Slider(100, range=0..100))
cap = CapHoles(Brep=cyl)
ilineartetraprism = ILinearTetraPrism(
    MinimumSize=Slider(1, range=0..1),
    MaximunSize=Slider(2, range=0..10),
    CurvatureAdapt=Toggle(True),
    MinimumElements=6,
    Optimization=0,
    QualityType=2,
    QualityThreshold=0.3,
    Massive_Refinement=False)
ifillbrep = IFillBrep(Brep=cap, ISettings=ilineartetraprism)  # -> IMesh, Entities, Info
debrep = DeconstructBrep(Brep=cap)  # -> Faces, Edges, Vertices
lefi = LeMeshFromIMesh(Header="Cantilever", IMesh=ifillbrep.IMesh)  # -> LeMesh, Mesh, Edges
panel = Panel("""false
false
true""")
converttoquadric = ConvertToQuadric(LeMesh=lefi.LeMesh, Brep=cap)  # -> LeMesh, Mesh, Edges
Z = UnitZ(Factor=Slider(1, range=0..1))
item = ListItem(List=debrep.Faces, Index=Slider(2, range=0..5), Wrap=True)
neg = Negative(Value=Z)
item_2 = ListItem(List=debrep.Faces, Index=Slider(1, range=0..5), Wrap=True)
vec = VectorXYZ(XComponent=0, YComponent=0, ZComponent=0)  # -> Vector, Length
panel_2 = Panel(converttoquadric.LeMesh)
panel_3 = Panel("""0.0
0.10
1.00""")
panel_4 = Panel("""100.0
110.0
120.0""")
conss = ConstructSolverSettings(Method=Slider(0, range=0..12), Precondition=Slider(5, range=0..12), MaxIter=100, Residual=1e-08)
constep = ConstructStep(SubSteps=Slider(10, range=0..10), Convergence=1e-06, MaxIterations=100)
lemat_plamises = LeMaterial_Plastic_Mises(Name="steel", Density="1", YoungsModulus="205000", PoissonRatio="0.3", PlasticStress=panel_4, PlasticStrain=panel_3)
conbc = ConstructBoundaryCondition(TargetGroupName="Fix", Type=0, Values=vec.Vector, Constraints=[True, True, True])
conbc_2 = ConstructBoundaryCondition(TargetGroupName="Load", Type=Slider(0, range=0..10), Values=neg, Constraints=panel)
congrpsurf = GroupFromSurface(Name="Fix", LeMesh=converttoquadric.LeMesh, Surface=item_2, GroupType=Slider(0, range=0..2), Tolerance=1e-06)  # -> Group, Geometry, NodeIds
congrpsurf_2 = GroupFromSurface(Name="Load", LeMesh=converttoquadric.LeMesh, Surface=item, GroupType=Slider(0, range=0..2), Tolerance=1e-06)  # -> Group, Geometry, NodeIds
grpentire = GroupEntireLeMesh(Name="EGRP1", LeMesh=converttoquadric.LeMesh)
conlesection_solid = ConstructLeSectionSolid(EGroups="EGRP1", LeMaterial=lemat_plamises)
conlecnt = ConstructLeControl(SolutionType=Slider(1, range=0..1), BoundaryConditions=flatten([conbc, conbc_2]), Step=constep, Solver=conss)
panel_5 = Panel(conlecnt)
conleasm = LeAssembleModel(
    LeMesh=converttoquadric.LeMesh,
    LeGroup=flatten([congrpsurf.Group, grpentire, congrpsurf_2.Group]),
    LeSection=conlesection_solid,
    LeControl=conlecnt)
path = FilePath("C:\Users\hiroa\Desktop\lemur_test\")
panel_6 = Panel(conleasm)
leexe = LeExecute(LeAssemble=conleasm, Thread="-1", Process="4", Dir=path, Run=Toggle(True))  # -> LeMesh, Dir
panel_7 = Panel(leexe.LeMesh)
number_slider = Slider(10, range=0..10)

getnodalresult = NodalResult(LeMesh=leexe.LeMesh, TargetResultName="DISPLACEMENT", Step=number_slider, NodeIDs=congrpsurf_2.NodeIds)
num2pt = NumbersToPoints(Numbers=getnodalresult, Mask=4)
vlen = VectorLength(Vector=num2pt)  # -> flatten(Length)
sort = SortList(Keys=vlen)  # -> Keys, ValuesA
lastdex = LastIndex(List=sort.Keys)
item_3 = ListItem(List=sort.Keys, Index=lastdex, Wrap=True)
panel_8 = Panel(item_3)

getnodalresult_2 = NodalResult(LeMesh=leexe.LeMesh, TargetResultName="REACTION_FORCE", Step=number_slider, NodeIDs=congrpsurf.NodeIds)
num2pt_2 = NumbersToPoints(Numbers=getnodalresult_2, Mask=4)
ma = MassAddition(Input=flatten(num2pt_2))  # -> Result, PartialResults
panel_9 = Panel(ma.Result)

number_slider_2 = Slider(10, range=0..10)
lecontour = ShowResultContour(
    LeMesh=leexe.LeMesh,
    Step=number_slider,
    ResultName="NodalMISES",
    ContourSet=Slider(2, range=0..10),
    DispScale=Slider(10, range=0..10))  # -> Mesh, Color, Text
legend = Legend(Colour=lecontour.Color, Tags=lecontour.Text, LegendType=1)
